% Simulink data dictionary robotModelData.sldd

encoderDimCtrl = Simulink.VariantControl(Value=1, ActivationTime="update diagram", ValueType="Numeric")
mainStateEstCtrl = Simulink.VariantControl(Value=1, ActivationTime="update diagram", ValueType="Numeric")
motorDimCtrl = Simulink.VariantControl(Value=1, ActivationTime="update diagram", ValueType="Numeric")
tiltEstCtrl = Simulink.VariantControl(Value=1, ActivationTime="update diagram", ValueType="Numeric")
gyroToUnit = single(14.375)
accelToUnit = single(0.004)
PWMPeriod = single(0.1)
MaxMotorVoltage = single(9)

RobotVariantConfig = Simulink.VariantConfigurationData(
  struct(
    Configurations=struct(
      Name="RobotConfig",
      Description="",
      ControlVariables=[struct(
        Name="controlAlgCtrl",
        Value=Simulink.VariantControl(Value=1, ActivationTime="update diagram", ValueType="Numeric"),
        Source="robotModelData.sldd"), struct(
        Name="encoderDimCtrl",
        Value=Simulink.VariantControl(Value=1, ActivationTime="update diagram", ValueType="Numeric"),
        Source="robotModelData.sldd"), struct(
        Name="tiltEstCtrl",
        Value=Simulink.VariantControl(Value=1, ActivationTime="update diagram", ValueType="Numeric"),
        Source="robotModelData.sldd"), struct(
        Name="motorDimCtrl",
        Value=Simulink.VariantControl(Value=1, ActivationTime="update diagram", ValueType="Numeric"),
        Source="robotModelData.sldd")]),
    VariantConfigurations=struct(
      Name="RobotConfig",
      Description="",
      ControlVariables=[struct(
        Name="controlAlgCtrl",
        Value=Simulink.VariantControl(Value=1, ActivationTime="update diagram", ValueType="Numeric"),
        Source="robotModelData.sldd"), struct(
        Name="encoderDimCtrl",
        Value=Simulink.VariantControl(Value=1, ActivationTime="update diagram", ValueType="Numeric"),
        Source="robotModelData.sldd"), struct(
        Name="tiltEstCtrl",
        Value=Simulink.VariantControl(Value=1, ActivationTime="update diagram", ValueType="Numeric"),
        Source="robotModelData.sldd"), struct(
        Name="motorDimCtrl",
        Value=Simulink.VariantControl(Value=1, ActivationTime="update diagram", ValueType="Numeric"),
        Source="robotModelData.sldd")],
      SubModelConfigurations=[]),
    Constraints=[],
    PreferredConfiguration="",
    DefaultConfigurationName="",
    DataDictionaryName="",
    DataDictionarySection="",
    AreSubModelConfigurationsMigrated=true,
    ComponentConfigurationData=[],
    Version="24.1"))

controlAlgCtrl = Simulink.VariantControl(Value=1, ActivationTime="update diagram", ValueType="Numeric")
wheelRadius = single(0.05)
sampleTime = 0.01
CPR = 2184
wheelBase = single(0.15)