% Simulink data dictionary variantControlsData.sldd

encoderDimCtrl = Simulink.VariantControl(Value=1, ActivationTime="update diagram", ValueType="Numeric")
mainStateEstCtrl = Simulink.VariantControl(Value=2, ActivationTime="update diagram", ValueType="Numeric")

controlAlgCtrl = Simulink.VariantControl(
  Value=Simulink.Parameter(Value=controlEnum.PID, DataType="Enum: controlEnum"),
  ActivationTime="update diagram",
  ValueType="Simulink.Parameter")

tiltEstCtrl = Simulink.VariantControl(
  Value=Simulink.Parameter(Value=tiltEnum.tiltAngleComplementaryFilter, DataType="Enum: tiltEnum"),
  ActivationTime="update diagram",
  ValueType="Simulink.Parameter")

motorDimCtrl = Simulink.VariantControl(
  Value=Simulink.Parameter(Value=driveEnum.Motor_drive_1D, DataType="Enum: driveEnum"),
  ActivationTime="update diagram",
  ValueType="Simulink.Parameter")